# Grasshopper definition vicc_AdvancedGeometry_2.1.gh (Grasshopper 1.0.7)

number_slider = Slider(300, range=0..1000)
neg = Negative(Value=number_slider)
cir = Circle(Plane=PlaneXY(0, 0, 0), Radius=Slider(2000, range=0..10000))
offset = OffsetCurve(Curve=cir, Distance=[neg, number_slider], Corners=1)
divide = DivideCurve(Curve=cir, Count=Slider(14, range=0..100), Kinks=False)  # -> Points, Tangents, Parameters
number_slider_2 = Slider(20, range=0..100)
number_slider_3 = Slider(30, range=0..100)
shatter = Shatter(Curve=offset, Parameters=divide.Parameters)
tstat = TreeStatistics(Tree=shatter)  # -> Paths, Length, Count
series = Series(Start=0, Step=1, Count=tstat.Count)
series_2 = Series(Start=series, Step=1, Count=tstat.Length)
# 今回紹介したい箇所
planesrf = PlaneSurface(Plane=PlaneXY(0, 0, 0), XSize=number_slider_2, YSize=number_slider_3)
mod = Modulus(A=series_2, B="2")
knob = ControlKnob(Decimals=0, Limit=True, Maximum=360, Minimum=0, Range=360, Value=54)
area = Area(Geometry=planesrf)  # -> Area, Centroid
cull = CullPattern(List=shatter, CullPattern=mod)
bang = ExplodeTree(Data=cull)  # -> _00000, _00001
rad = Radians(Degrees=knob)
orient = Orient(Geometry=planesrf, Source=area.Centroid, Target=PlaneXY(0, 0, 0))  # -> Geometry, Transform
xz = XZPlane(Origin=Point(0, 0, 0))
weave = Weave(Pattern=[1, 0], Stream0=bang._00000, Stream1=bang._00001, NullGaps=False)
expression = Expression(z=number_slider_2, y=number_slider_3, x=rad, Expression="1+y/z*tan(x)")
expression_2 = Expression(x=rad, Expression="1/cos(x)")
shear = ShearAngle(Base=xz, AngleX="0", AngleY=rad)  # -> Geometry, Transform
shift = ShiftList(List=weave, Shift=1, Wrap=True)
number_slider_4 = Slider(70, range=0..100)
scale_nu = ScaleNU(Geometry=orient.Geometry, Plane=PlaneXY(0, 0, 0), ScaleX=expression, ScaleY=expression_2, ScaleZ=1)  # -> Geometry, Transform
blendc = BlendCurve(CurveA=weave, CurveB=shift, BulgeA=1, BulgeB=1, Continuity=0)
join = JoinCurves(Curves=flatten([blendc, weave]), Preserve=False)
mesh_uv = MeshSurface(Surface=scale_nu.Geometry, UCount=number_slider_4, VCount=number_slider_4, Overhang=True, Equalize=False)
transform = Transform(Geometry=mesh_uv, Transform=shear.Transform)
disc = Discontinuity(Curve=join, Level=1)  # -> Points, Parameters
scale_nu_2 = ScaleNU(Geometry=orient.Geometry, Plane=PlaneXY(0, 0, 0), ScaleX=1, ScaleY="2", ScaleZ=1)  # -> Geometry, Transform
nurbs = NurbsCurve(Vertices=disc.Points, Degree=3, Periodic=True)  # -> Curve, Length, Domain
rad_2 = Radians(Degrees=[Slider(0, range=0..360), Slider(60, range=0..360), Slider(111, range=0..360)])
Z = UnitZ(Factor=[Slider(0, range=0..1000), Slider(2500, range=0..5000), Slider(3942, range=0..5000)])
faceb = FaceBoundaries(Mesh=transform)
crv = Curve(scale_nu_2.Geometry)
colom = CollisionOneMany(Collider=faceb, Obstacles=crv)  # -> Collision, Index
colom_2 = CollisionOneMany(Collider=faceb, Obstacles=scale_nu_2.Geometry)  # -> Collision, Index
move = Move(Geometry=nurbs.Curve, Motion=Z)  # -> Geometry, Transform
and = GateAnd(A=invert(colom.Collision), B=colom_2.Collision)
rotate = Rotate(Geometry=move.Geometry, Angle=rad_2, Plane=PlaneXY(0, 0, 0))  # -> Geometry, Transform
cullf = CullFaces(Mesh=transform, Pattern=invert(and))
cullf_2 = CullFaces(Mesh=mesh_uv, Pattern=invert(and))
loft = Loft(Curves=rotate.Geometry, Options={Adjust=False, Closed=False, LoftEnds=0, LoftSimp=0, LoftType=0, Rebuild=10, Refit=0.01})
demesh = DeconstructMesh(Mesh=cullf)  # -> Vertices, Faces, Colours, Normals
srf_cp = SurfaceClosestPoint(Point=demesh.Vertices, Surface=reparameterize(orient.Geometry))  # -> Point, UVPoint, Distance
offset_2 = OffsetSurface(Surface=loft, Distance=Slider(20, range=0..100), Retrim=True)
evalsrf = EvaluateSurface(Surface=reparameterize(offset_2), Point=srf_cp.UVPoint)  # -> Point, Normal, UDirection, VDirection, Frame
evalsrf_2 = EvaluateSurface(Surface=reparameterize(loft), Point=srf_cp.UVPoint)  # -> Point, Normal, UDirection, VDirection, Frame
conmesh = ConstructMesh(Vertices=evalsrf.Point, Faces=demesh.Faces)
conmesh_2 = ConstructMesh(Vertices=evalsrf_2.Point, Faces=demesh.Faces)
faceb_2 = FaceBoundaries(Mesh=conmesh)
faceb_3 = FaceBoundaries(Mesh=conmesh_2)
faceb_4 = FaceBoundaries(Mesh=cullf_2)
explode = Explode(Curve=faceb_2, Recursive=True)  # -> Segments, Vertices
explode_2 = Explode(Curve=faceb_3, Recursive=True)  # -> Segments, Vertices
explode_3 = Explode(Curve=faceb_4, Recursive=True)  # -> Segments, Vertices
X = UnitX(Factor=1)
dprod = DotProduct(VectorA=explode_3.Segments, VectorB=X, Unitize=True)
panel = Panel("""0
1""")
abs = Absolute(Value=dprod)
num = Number(panel)
num_2 = Number("0")
fsim = FindSimilarMember(Data=abs, Set=num)  # -> Hit, Index
mindex = MemberIndex(Set=fsim.Hit, Member=num_2)  # -> Index, Count
item = ListItem(List=explode_3.Segments, Index=mindex.Index, Wrap=True)
midpt = CurveMiddle(Curve=item)
pdecon = Deconstruct(Point=midpt)  # -> XComponent, YComponent, ZComponent
sort = SortList(Keys=pdecon.XComponent, ValuesA=mindex.Index)  # -> Keys, reverse(ValuesA)
item_2 = ListItem(List=sort.ValuesA, Index=0, Wrap=True)  # -> Item, Item1
item_3 = ListItem(List=explode.Segments, Index=item_2.Item, Wrap=True)
item_4 = ListItem(List=explode_2.Segments, Index=item_2.Item1, Wrap=True)
flip = FlipCurve(Curve=item_3)  # -> Curve, Flag
rulesrf = RuledSurface(CurveA=flip.Curve, CurveB=item_4)
